# Grasshopper definition kuka_prc_test.ghx (Grasshopper 1.0.7)
# plug-ins: KUKA|prc - parametric robot control

number_slider = Slider(500, range=0..1000)
pt = ConstructPoint(XCoordinate=number_slider, YCoordinate=0, ZCoordinate=number_slider)
X = UnitX(Factor=1)
Y = UnitY(Factor=1)
pl = ConstructPlane(Origin=pt, XAxis=expr("-x", X), YAxis=Y)
lin_move = LINearMovementKUKAPrc(TargetAsPlane=pl, extaxenabled=False, interpolation="C_DIS")
kr6_10_r1100_2 = AgilusKR610R11002Robot(infiniterot=False)
kuka_prc = KUKAPrcCORE(
    SimulationSlider=Slider(0, range=0..1),
    KUKAPrcCommands=lin_move,
    Robot=kr6_10_r1100_2,
    PRC_BaseExpose=False,
    PRC_SaveNameExpose=False,
    PRCsettings="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")  # -> RobotGeometry, AnalysisOutput
